# Dynamo graph Remove_Family_Backups.dyn (Dynamo 2.12.1.8246)

# group: REMOVE REVIT FAMILY BACKUPS
# note: DYNAMO VERSION: 2.12.1.8246
# VERSION:  1.0
# CREATED BY: Emelie Wärmlund
# DATE CREATED: 20242016
# LAST MODIFIED:
# DESCRIPTION:
# Removes all family backups of a directory

# group: USER INPUT
directory_path = Directory("")  # graph input

# group: PYTHON
python_script = Python(IN[0]=directory_path)  # CPython3
# ---------- python_script.python (26 lines) ----------
import os
import re


directory=IN[0]
deleted=[]
failed=[]

def remove_family_backups(directory):
    # Define a regex pattern to match the file structure: <model_name>.<nnnn>.rfa
    pattern = r"^.*\.\d{4}\.rfa$"

    for root, dirs, files in os.walk(directory):
        for file_name in files:
            if re.match(pattern, file_name):
                file_path = os.path.join(root, file_name)
                try:
                    os.remove(file_path)
                    deleted.append("Deleted: {}".format(file_path))
                    
                except Exception as e:
                    failed.append("Failed to delete {}: {}".format(file_path, str(e)))

remove_family_backups(directory)

OUT = deleted,failed
# ----------------------------------------

# group: OUTPUT
result = Watch(python_script)  # graph output
